# Grasshopper definition Beispiel_scorpio_robotIO.gh (Grasshopper 1.0.7)
# plug-ins: Utilities, IO_3.3.0

fugenanzahl = Slider(8, range=2..50)

# ---- group: Steinformat
X = Slider(90, range=10..100)
Y = Slider(60, range=10..100)
Z = Slider(30, range=10..100)

# ----
mauerfläche = Surface(<surface referenced from the Rhino model>)
steinquelle_boxzentrum = Point(<point referenced from the Rhino model>)
x2 = Multiplication(A=fugenanzahl, B=2)
subtraction = Subtraction(A=x2, B=1)

# ---- group: Erzeugung der Schichten mit Verschiebung
contour = Contour(Shape=mauerfläche, Point=Point(-665.858571, -385.6911437, -502.1353036), Direction=Vector(0, 0, 1), Distance=Z)  # -> flatten(Contours)
cull = CullPattern(List=contour, CullPattern=[True, False])
cull_2 = CullPattern(List=contour, CullPattern=[False, True])
divide = DivideCurve(Curve=cull, Count=subtraction, Kinks=False)  # -> Points, Tangents, Parameters
divide_2 = DivideCurve(Curve=cull_2, Count=subtraction, Kinks=False)  # -> Points, Tangents, Parameters
cull_3 = CullPattern(List=divide_2.Points, CullPattern=[True, False])
cull_4 = CullPattern(List=divide.Points, CullPattern=[False, True])
group = Group(Objects=cull_3)
group_2 = Group(Objects=cull_4)

# ---- group: Anzahl der Wiederholungen
lng = ListLength(List=contour)
division = Division(A=lng, B=2)
multiplication = Multiplication(A=lng, B=subtraction)
division_2 = Division(A=multiplication, B=2)
addition = Addition(A=division, B=division_2)

# ----
weave = Weave(Pattern=[0, 1], Stream0=flatten(group_2), Stream1=flatten(group), NullGaps=False)  # -> graft(Weave)
ungroup = Ungroup(Group=weave)

# ---- group: Greifpunkte (Absetzen)
crv_cp = CurveClosestPoint(Point=ungroup, Curve=graft(contour))  # -> Point, Parameter, Distance

# ---- group: Ermittlung der Grunddrehung anhand des Tangens
eval = EvaluateCurve(Curve=graft(contour), Parameter=crv_cp.Parameter)  # -> Point, Tangent, Angle
X_2 = UnitX(Factor=1)
angle = Angle(VectorA=X_2, VectorB=eval.Tangent)  # -> flatten(Angle), Reflex

# ---- group: Drehung
panel = Panel("""0
Pi/4
0
-Pi/4""")
lng_2 = ListLength(List=flatten(eval.Point))
repeat = RepeatData(Data=panel, Length=lng_2)
addition_2 = Addition(A=repeat, B=angle.Angle)
xy = XYPlane(Origin=eval.Point)
rotate = Rotate(Geometry=flatten(xy), Angle=addition_2, Plane=flatten(eval.Point))  # -> Geometry, Transform

# ---- group: Erstellung Steine
division_3 = Division(A=X, B=2)
division_4 = Division(A=Y, B=2)
division_5 = Division(A=Z, B=2)
box = CenterBox(Base=rotate.Geometry, X=division_3, Y=division_4, Z=division_5)

# ---- group: Greifpunkt (Aufnehmen)
Z_2 = UnitZ(Factor=division_5)
move = Move(Geometry=steinquelle_boxzentrum, Motion=Z_2)  # -> Geometry, Transform
flip = FlipPlane(Plane=move.Geometry)

# ---- group: Wiederholung
dup = DuplicateData(Data=flip, Number=addition, Order=True)  # -> simplify(graft(Data))

# ---- group: Hebehöhe nach Aufnahme
Z_3 = UnitZ(Factor=200)
move_2 = Move(Geometry=dup, Motion=Z_3)  # -> Geometry, Transform

# ----
flip_2 = FlipPlane(Plane=simplify(graft(rotate.Geometry)))

# ---- group: Hebehöhe vor Absetzen
Z_4 = UnitZ(Factor=200)
move_3 = Move(Geometry=flip_2, Motion=Z_4)  # -> Geometry, Transform

# ---- group: Sortierung der Punkte und Pfade
merge = Merge(Data1=dup, Data2=move_2.Geometry, Data3=move_3.Geometry)
merge_2 = Merge(Data1=flip_2, Data2=move_3.Geometry, Data3=move_2.Geometry)
path_nehme = Path(
    Plane=merge,
    a_a="Path NEHME",
    a_b_a=False,
    a_b_b=False,
    a_b_c=False,
    a_b_d=False,
    a_b_e=100,
    a_b_f=1,
    a_b_g=1,
    a_b_h=2,
    a_c_a=False,
    a_c_b=False,
    a_c_c=False,
    a_c_d=False,
    a_c_e=200,
    a_c_f=1,
    a_c_g=1,
    a_c_h=2,
    a_d_a=3,
    a_d_b0_a=3,
    a_d_b0_b_a=0.5,
    a_d_b1_a=0,
    a_d_b1_b_a="0",
    a_d_b1_b_b=True,
    a_d_b2_a=3,
    a_d_b2_b_a=0.5,
    a_e_a=0)
path_gebe = Path(
    Plane=merge_2,
    a_a="Path GEBE",
    a_b_a=False,
    a_b_b=False,
    a_b_c=False,
    a_b_d=False,
    a_b_e=100,
    a_b_f=1,
    a_b_g=1,
    a_b_h=2,
    a_c_a=False,
    a_c_b=False,
    a_c_c=False,
    a_c_d=False,
    a_c_e=200,
    a_c_f=1,
    a_c_g=1,
    a_c_h=2,
    a_d_a=3,
    a_d_b0_a=3,
    a_d_b0_b_a=1,
    a_d_b1_a=0,
    a_d_b1_b_a="0",
    a_d_b1_b_b=False,
    a_d_b2_a=3,
    a_d_b2_b_a=1,
    a_e_a=0)
weave_2 = Weave(Pattern=[0, 1], Stream0=path_nehme, Stream1=path_gebe, NullGaps=False)

# ---- group: Werkzeug
mesh = MeshBrep(
    Brep=<geometry referenced from the Rhino model>,
    Settings={GridMaxCount=0, GridMinCount=16, JaggedSeams=False, MaxEdgeLength=0, MinEdgeLength=0.0001, MinTolerance=0, Refine=True, RefineAngle=0, RelativeTolerance=0.65, SimplePlanes=True, Tolerance=0})
pt = Point(<point referenced from the Rhino model>)
pt_2 = Point(<point referenced from the Rhino model>)
create_tool = CreateTool(
    Plane=pt_2,
    Plane_2=pt,
    Meshes=mesh,
    a_a=True,
    a_b=0.1,
    a_e=False,
    a_c_a=[1, 0, 0, 0, 0, 1, 0, 0, 0, 0, 1, 0.1, 0, 0, 0, 1],
    a_d_a=0,
    a_d_b=0,
    a_d_c=0)

# ---- group: Roboter
pt_3 = Point(<point referenced from the Rhino model>)
pln = Plane(pt_3)
robot = Robot(
    Plane=pln,
    Tool=create_tool,
    a_a="UR5",
    a_b=True,
    a_c_a=[0, -1.570796327, 1.570796327, -1.570796327, -1.570796327, 0],
    c_a="End Position",
    c_b_a=False,
    c_b_b=False,
    c_b_c=False,
    c_b_d=False,
    c_b_e=100,
    c_b_f=1,
    c_b_g=1,
    c_b_h=2,
    c_c_a=True,
    c_d_a=0,
    c_e_a=0)

# ----
timeline = TimeLine(Robots=robot, Planes=weave_2, a=14, b=20, c=1, d_b_a=0.284653157, d_b_b=False, d_b_c=False, d_b_d=True)  # -> MultiData, Index, Time
scorpion_feedback_connected = ScorpionFeedback()  # -> out, TCP, IK, ProgramStatus
# ---------- scorpion_feedback_connected: Python ----------
#Code deveoped by Olivier Roulet-Dubonnet for python-urx plugin

__author__ = "Olivier Roulet-Dubonnet"
__copyright__ = "Copyright 2011-2012, Olivier Roulet-Dubonnet"
__credits__ = ["Olivier Roulet-Dubonnet"]
__license__ = "GPLv3"
__version__ = "0.4"
__status__ = "Development"

ghenv.Component.Message = 'Scorpion 0.2'

from threading import Thread, Condition, Lock
import logging
import struct
import socket, math, time
import time
from copy import copy
import socket, time




class ParsingException(Exception):
    def __init__(self, *args):
        Exception.__init__(self, *args)



class ParserUtils(object):
    def __init__(self, logLevel=logging.WARN):
        self.logger = logging.getLogger(__name__)
        self.logger.setLevel(logLevel)

    def parse(self, data):
        """
        parse a packet from the UR socket and return a dictionary with the data
        """
        allData = {}
        #print "Total size ", len(data)
        while data:
            psize, ptype, pdata, data = self.analyze_header(data)
            #print "We got packet with size %i and type %s" % (psize, ptype)
            if ptype == 16:
                allData["SecondaryClientData"] = self._get_data(pdata, "!iB", ("size", "type"))
                data = (pdata + data)[5:] # This is the total size so we resend data to parser
            elif ptype == 0:
                allData["RobotModeData"] = self._get_data(pdata, "!iBQ???????Bd", ("size", "type", "timestamp", "isRobotConnected", "isRealRobotEnabled", "isPowerOnRobot", "isEmergencyStopped", "isSecurityStopped", "isProgramRunning", "isProgramPaused", "robotMode", "speedFraction"))
            elif ptype == 1:
                tmpstr = ["size", "type"]
                for i in range(0, 6):
                    tmpstr += ["q_actual%s" % i, "q_target%s" % i, "qd_actual%s" % i, "I_actual%s" % i, "V_actual%s" % i, "T_motor%s" % i ,"T_micro%s" % i, "jointMode%s" % i]

                allData["JointData"] = self._get_data(pdata, "!iB dddffffB dddffffB dddffffB dddffffB dddffffB dddffffB", tmpstr)

            elif ptype == 4:
                allData["CartesianInfo"] = self._get_data(pdata, "iBdddddd", ("size", "type", "X", "Y", "Z", "Rx", "Ry", "Rz"))
            elif ptype == 5:
                allData["LaserPointer(OBSOLETE)"] = self._get_data(pdata, "iBddd" , ("size", "type"))
            elif ptype == 3:
                allData["MasterBoardData"] = self._get_data(pdata, "iBhhbbddbbddffffBBb" , ("size", "type", "digitalInputBits", "digitalOutputBits", "analogInputRange0", "analogInputRange1", "analogInput0", "analogInput1", "analogInputDomain0", "analogInputDomain1", "analogOutput0", "analogOutput1", "masterBoardTemperature", "robotVoltage48V", "robotCurrent", "masterIOCurrent"))#, "masterSafetyState" ,"masterOnOffState", "euromap67InterfaceInstalled"   ))
            elif ptype == 2:
                allData["ToolData"] = self._get_data(pdata, "iBbbddfBffB" , ("size", "type", "analoginputRange2", "analoginputRange3", "analogInput2", "analogInput3", "toolVoltage48V", "toolOutputVoltage", "toolCurrent", "toolTemperature", "toolMode" ))

            #elif ptype == 8:
                    #allData["varMessage"] = self._get_data(pdata, "!iBQbb iiBAcAc", ("size", "type", "timestamp", "source", "robotMessageType", "code", "argument", "titleSize", "messageTitle", "messageText"))
            #elif ptype == 7:
                    #allData["keyMessage"] = self._get_data(pdata, "!iBQbb iiBAcAc", ("size", "type", "timestamp", "source", "robotMessageType", "code", "argument", "titleSize", "messageTitle", "messageText"))

            elif ptype == 20:
                tmp = self._get_data(pdata, "!iB Qbb", ("size", "type", "timestamp", "source", "robotMessageType"))
                if tmp["robotMessageType"] == 3:
                    allData["VersionMessage"] = self._get_data(pdata, "!iBQbb bAbBBiAb", ("size", "type", "timestamp", "source", "robotMessageType", "projectNameSize", "projectName", "majorVersion", "minorVersion", "svnRevision", "buildDate"))
                elif tmp["robotMessageType"] == 6:
                    allData["robotCommMessage"] = self._get_data(pdata, "!iBQbb iiAc", ("size", "type", "timestamp", "source", "robotMessageType", "code", "argument", "messageText"))
                elif tmp["robotMessageType"] == 1:
                    allData["labelMessage"] = self._get_data(pdata, "!iBQbb iAc", ("size", "type", "timestamp", "source", "robotMessageType", "id", "messageText"))
                elif tmp["robotMessageType"] == 2:
                    allData["popupMessage"] = self._get_data(pdata, "!iBQbb ??BAcAc", ("size", "type", "timestamp", "source", "robotMessageType", "warning", "error", "titleSize", "messageTitle", "messageText"))
                elif tmp["robotMessageType"] == 0:
                    allData["messageText"] = self._get_data(pdata, "!iBQbb Ac", ("size", "type", "timestamp", "source", "robotMessageType", "messageText"))
                elif tmp["robotMessageType"] == 8:
                    allData["varMessage"] = self._get_data(pdata, "!iBQbb iiBAcAc", ("size", "type", "timestamp", "source", "robotMessageType", "code", "argument", "titleSize", "messageTitle", "messageText"))
                elif tmp["robotMessageType"] == 7:
                    allData["keyMessage"] = self._get_data(pdata, "!iBQbb iiBAcAc", ("size", "type", "timestamp", "source", "robotMessageType", "code", "argument", "titleSize", "messageTitle", "messageText"))
                elif tmp["robotMessageType"] == 5:
                    allData["keyMessage"] = self._get_data(pdata, "!iBQbb iiAc", ("size", "type", "timestamp", "source", "robotMessageType", "code", "argument", "messageText"))
                else:
                    self.logger.debug("Message type parser not implemented ", tmp)
            else:
                self.logger.debug("Unknown packet type %s with size %s" % (ptype, psize))

        return allData

    def _get_data(self, data, fmt, names):
        """
        fill data into a dictionary
            data is data from robot packet
            fmt is struct format, but with added A for arrays and no support for numerical in fmt
            names args are strings used to store values
        """
        tmpdata = copy(data)
        fmt = fmt.strip() # space may confuse us
        d = dict()
        i = 0
        j = 0
        while j < len(fmt) and i < len(names):
            f = fmt[j]
            if f in (" ", "!", ">", "<"):
                j += 1
            elif f == "A": #we got an array
                # first we need to find its size
                if j == len(fmt) - 2: # we are last element, size is the rest of data in packet
                    arraysize = len(tmpdata)
                else: # size should be given in last element
                    asn =  names[i-1]
                    if not asn.endswith("Size"):
                        raise ParsingException("Error, array without size ! %s %s" % (asn, i))
                    else:
                        arraysize = d[asn]
                d[names[i]] = tmpdata[0:arraysize]
                #print "Array is ", names[i], d[names[i]]
                tmpdata = tmpdata[arraysize:]
                j += 2
                i += 1
            else:
                fmtsize = struct.calcsize(fmt[j])
                #print "reading ", f , i, j,  fmtsize, len(tmpdata)
                if len(tmpdata) < fmtsize: #seems to happen on windows
                    raise ParsingException("Error, length of data smaller than advertized: ", len(tmpdata), fmtsize, "for names ", names, f, i, j)
                d[names[i]] = struct.unpack("!" + f, tmpdata[0:fmtsize])[0]
                #print names[i], d[names[i]]
                tmpdata = tmpdata[fmtsize:]
                j += 1
                i += 1
        return d

    def get_header(self, data):
        return struct.unpack("!iB", data[0:5])

    def analyze_header(self, data):
        """
        read first 5 bytes and return complete packet
        """
        if not len(data) >= 5:
            raise ParsingException("Packet size %s smaller than header size (5 bytes)" % len(data))
        else:
            psize, ptype = self.get_header(data)
            if psize < 5:
                raise ParsingException("Error, declared length of data smaller than its own header(5): ", psize)
            elif psize > len(data):
                raise ParsingException("Error, length of data smaller (%s) than declared (%s)" %( len(data), psize))
        return psize, ptype, data[:psize], data[psize:]

    def find_first_packet(self, data):
        """
        find the first complete packet in a string
        returns None if none found
        """
        counter = 0
        while True:
            if len(data) >= 5:
                psize, ptype = self.get_header(data)
                if psize < 5 or psize > 2000 or ptype != 16:
                    data = data[1:]
                    counter += 1
                elif len(data) >= psize:
                    self.logger.debug("Got packet with size {0} and type {1}".format(psize, ptype))
                    if counter:
                        self.logger.info("Remove {0} bytes of garbage at begining of packet".format(counter))
                    #ok we we have somehting which looks like a packet"
                    return (data[:psize], data[psize:])
                else:
                    #packet is not complete
                    self.logger.debug("Packet is not complete, advertised size is {0}, received size is {1}, type is {2}".format(psize, len(data), ptype))
                    return None
            else:
                #self.logger.debug("data smaller than 5 bytes")
                return None


class SecondaryMonitor(Thread):
    """
    Monitor data from secondary port and send programs to robot
    """
    def __init__(self, host, logLevel=logging.WARN, parserLogLevel=logging.WARN):
        Thread.__init__(self)
        self.logger = logging.getLogger(self.__class__.__name__)
        self.logger.setLevel(logLevel)
        self._parser = ParserUtils(parserLogLevel)
        self._s_secondary = None
        self._dict = {}
        self._dictLock = Lock()
        
        self.host = host
        secondary_port = 30002   # Secondary client interface on Universal Robots
        self._s_secondary = socket.create_connection((self.host, secondary_port), timeout=0.5)
        self._prog_queue = []
        self._prog_queue_lock = Lock()
        self._dataqueue = bytes()
        self._trystop = False # to stop thread
        self.running = False #True when robot is on and listening
        self._dataEvent = Condition()

        self.start()
        self.wait()# make sure we got some data before someone calls us

    def send_program(self, prog):
        """
        send program to robot in URRobot format
        If another program is send while a program is running the first program is aborded.
        """
        with self._prog_queue_lock:
            prog.strip()
            self.logger.debug("Sending program: " + prog)
            if type(prog) != bytes:
                prog = prog.encode()
            self._prog_queue.append(prog + b"\n")


    def run(self):
        """
        check program execution status in the secondary client data packet we get from the robot
        This interface uses only data from the secondary client interface (see UR doc)
        Only the last connected client is the primary client,
        so this is not guaranted and we cannot rely on information only
        send to the primary client(like program execution start ?!?!?)
        """

        while not self._trystop:
            with self._prog_queue_lock:
                if len(self._prog_queue) > 0:
                    prog = self._prog_queue.pop(0)
                    self._s_secondary.send(prog)

            data = self._get_data()
            try:
                with self._dictLock:
                    self._dict = self._parser.parse(data)
            except ParsingException as ex:
                self.logger.warn("Error parsing one packet from urrobot: " + str(ex) )
                continue

            if "RobotModeData" not in self._dict:
                self.logger.warn( "Got a packet from robot without RobotModeData, strange ...")
                continue

            if self._dict["RobotModeData"]["robotMode"] == 0 \
                            and self._dict["RobotModeData"]["isRealRobotEnabled"] == True \
                            and self._dict["RobotModeData"]["isEmergencyStopped"] == False \
                            and self._dict["RobotModeData"]["isSecurityStopped"] == False \
                            and self._dict["RobotModeData"]["isRobotConnected"] == True \
                            and self._dict["RobotModeData"]["isPowerOnRobot"] == True:
                self.running = True
            else:
                if self.running == True:
                    self.logger.error("Robot not running: " + str( self._dict["RobotModeData"]))
                self.running = False
            with self._dataEvent:
                self._dataEvent.notifyAll()

    def _get_data(self):
        """
        returns something that looks like a packet, nothing is guaranted
        """
        while True:
            ans = self._parser.find_first_packet(self._dataqueue[:])
            if ans:
                self._dataqueue = ans[1]
                return ans[0]
            else:
                #self.logger.debug("Could not find packet in received data")
                tmp = self._s_secondary.recv(1024)
                self._dataqueue += tmp

    def wait(self):
        """
        wait for next data packet from robot
        """
        with self._dataEvent:
            self._dataEvent.wait()

    def get_cartesian_info(self, wait=False):
        if wait:
            self.wait()
        with self._dictLock:
            if "CartesianInfo" in self._dict:
                return self._dict["CartesianInfo"]
            else:
                return None

    def get_all_data(self, wait=False):
        """
        return last data obtained from robot in dictionnary format
        """
        if wait:
            self.wait()
        with self._dictLock:
            return self._dict.copy()

    def get_joint_data(self, wait=False):
        if wait:
            self.wait()
        with self._dictLock:
            if "JointData" in self._dict:
                return self._dict["JointData"]
            else:
                return None

    def is_program_running(self, wait=False):
        """
        return True if robot is executing a program
        Rmq: The refresh rate is only 10Hz so the information may be outdated
        """
        if wait:
            self.wait()
        with self._dictLock:
            return self._dict["RobotModeData"]["isProgramRunning"]
   


        


    def cleanup(self):
        self._trystop = True
        self.join()
        if self._s_secondary:
            with self._prog_queue_lock:
                self._s_secondary.close()

class URRobot(object):
    """
    Python interface to socket interface of UR robot.
    programs are send to port 3002
    data is read from secondary interface(10Hz?) and real-time interface(125Hz) (called Matlab interface in documentation)
    Since parsing the RT interface uses som CPU, and does not support all robots versions, it is disabled by default
    The RT interfaces is only used for the get_force related methods
    Rmq: A program sent to the robot i executed immendiatly and any running program is stopped
    """
    def __init__(self, host, useRTInterface=False, logLevel=logging.WARN):
        self.logger = logging.getLogger(self.__class__.__name__)
        if len(logging.root.handlers) == 0: #dirty hack
            logging.basicConfig()
        self.logger.setLevel(logLevel)
        self.host = host

        self.logger.info("Opening secondary monitor socket")
        self.secmon = SecondaryMonitor(self.host, logLevel=logLevel, parserLogLevel=logging.WARN) #data from robot at 10Hz

        if useRTInterface:
            self.logger.info("Opening real-time monitor socket")
            self.rtmon = urrtmon.URRTMonitor(self.host)# som information is only available on rt interface
        else:
            self.rtmon = None
        #the next 3 values must be conservative! otherwise we may wait forever
        self.jointEpsilon = 0.05 # precision of joint movem used to wait for move completion
        self.linearEpsilon = 0.0005 # precision of linear movement, used to wait for move completion
        self.radialEpsilon = 0.05 # precision of radial movement, used to wait for move completion
        #URScript is  limited in the character length of floats it accepts
        self.max_float_length = 6 # FIXME: check max length!!!
        if useRTInterface:
            self.rtmon.start()

        self.secmon.wait() # make sure we get data to not suprise clients


    def __repr__(self):
        return "Robot Object (IP=%s, state=%s)" % (self.host, self.secmon.get_all_data()["RobotModeData"])

    def __str__(self):
        return self.__repr__()

    def is_running(self): # legacy
        return self.secmon.running

    def is_program_running(self):
        return self.secmon.is_program_running()

    def send_program(self, prog):
        self.secmon.send_program(prog)

    def get_tcp_force(self, wait=True):
        """
        return measured force in TCP
        if wait==True, waits for next packet before returning
        """
        return self.rtmon.getTCFForce(wait)

    def get_force(self, wait=True):
        """
        length of force vector returned by get_tcp_force
        if wait==True, waits for next packet before returning
        """
        tcpf = self.get_tcp_force( wait)
        force = 0
        for i in tcpf:
            force += i**2
        return force**0.5

    def set_tcp(self, x=0, y=0, z=0, rx=0, ry=0, rz=0):
        """
        """
        if type(x) in (list, tuple):
            if len(x) != 6:
                raise Exception("Tcp is a 6 values list")
            else:
                arg = x
        else:
            arg = (x, y, z, rx, ry, rz)
        prog = "set_tcp(p[%s, %s, %s, %s, %s, %s])" % arg
        self.secmon.send_program(prog)

    def set_payload(self, weight):
        """
        set payload in Kg
        """
        prog = "set_payload(%s)" % weight
        self.secmon.send_program(prog)

    def set_gravity(self, vector):
        """
        set direction of gravity
        """
        prog = "set_gravity(%s)" % list(vector)
        self.secmon.send_program(prog)

    def send_message(self, msg):
        """
        send message to the GUI log tab on the robot controller
        """
        prog = "textmsg(%s)" % msg
        self.secmon.send_program(prog)

    def set_digital_out(self, output, val):
        """
        set digital output. val is a bool
        """
        if val in (True, 1):
            val = "True"
        else:
            val = "False"
        self.secmon.send_program('digital_out[%s]=%s' % (output, val))

    def get_analog_inputs(self):
        """
        get analog input
        """
        data = self.secmon.get_all_data()
        return data["MasterBoardData"]["analogInput0"], data["MasterBoardData"]["analogInput1"]


    def get_analog_in(self, nb):
        """
        get analog input
        """
        data = self.secmon.get_all_data()
        return data["MasterBoardData"]["analogInput" + str(nb)]

    def get_digital_in_bits(self):
        """
        get digital output
        """
        data = self.secmon.get_all_data()
        return data["MasterBoardData"]["digitalInputBits"]

    def get_digital_in(self, nb):
        """
        get digital output
        """
        data = self.secmon.get_all_data()
        val = data["MasterBoardData"]["digitalInputBits"]
        mask = 1 << nb
        if  (val & mask):
            return 1
        else:
            return 0

    def get_digital_out(self, val):
        """
        get digital output
        """
        data = self.secmon.get_all_data()
        output = data["MasterBoardData"]["digitalOutputBits"]
        mask = 1 << val
        if  (output & mask):
            return 1
        else:
            return 0

    def set_analog_out(self, output, val):
        """
        set analog output, val is a float
        """
        prog = "set_analog_output(%s, %s)" % (output, val)
        self.secmon.send_program(prog)

    def set_tool_voltage(self, val):
        """
        set voltage to be delivered to the tool, val is 0, 12 or 24
        """
        prog = "set_tool_voltage(%s)" % (val)
        self.secmon.send_program(prog)

    def movej(self, joints, acc=0.1, vel=0.05, wait=True, relative=False):
        """
        move in joint space
        """
        if relative:
            l = self.getj()
            joints = [v + l[i] for i, v in enumerate(joints)]
        joints = [round(j, self.max_float_length) for j in joints]
        prog = "movej(%s, a=%s, v=%s)" % (list(joints), acc, vel)
        joints.append(acc)
        joints.append(vel)
        prog = "movej([{},{},{},{},{},{}], a={}, v={})".format(*joints)
        self.send_program(prog)
        if not wait:
            return None
        else:
            self.wait_for_move()
            return self.getj()

    def wait_for_move(self):
        time.sleep(0.2)# it is important to sleep since robot may takes a while to get into running state
        while True:
            if not self.is_running():
                raise RobotException("Robot stopped")
            jts = self.secmon.get_joint_data(wait=True)
            finished = True
            for i in range(0, 6):
                if abs(jts["q_actual%s"%i] - jts["q_target%s"%i]) > self.radialEpsilon:
                    finished = False
                    break
            if finished and not self.secmon.is_program_running():
                return

    def getj(self, wait=False):
        """
        get joints position
        """
        jts = self.secmon.get_joint_data(wait)
        return [jts["q_actual0"], jts["q_actual1"], jts["q_actual2"], jts["q_actual3"], jts["q_actual4"], jts["q_actual5"]]

    def movel(self, tpose, acc=0.01, vel=0.01, wait=True, relative=False):
        """
        linear move
        """
        if relative:
            l = self.getl()
            tpose = [v + l[i] for i, v in enumerate(tpose)]
        tpose = [round(i, self.max_float_length) for i in tpose]
        #prog = "movel(p%s, a=%s, v=%s)" % (tpose, acc, vel)
        tpose.append(acc)
        tpose.append(vel)
        prog = "movel(p[{},{},{},{},{},{}], a={}, v={})".format(*tpose)
        self.send_program(prog)
        if not wait:
            return None
        else:
            self.wait_for_move()
            return self.getl()

    def getl(self, wait=False):
        """
        get TCP position
        """
        pose = self.secmon.get_cartesian_info(wait)
        if pose:
            pose = [pose["X"], pose["Y"], pose["Z"], pose["Rx"], pose["Ry"], pose["Rz"]]
        self.logger.debug("Current pose from robot: " + str(pose))
        return pose

    def movec(self, pose, pose_via, pose_to, acc, vel, wait=True):
        """
        Move Circular: Move to position (circular in tool-space)
        see UR documentation
        """
        pose = [round(i, self.max_float_length) for i in pose]
        pose_via = [round(i, self.max_float_length) for i in pose_via]
        pose_to = [round(i, self.max_float_length) for i in pose_to]
        prog = "movec(p%s, p%s, p%s, a=%s, v=%s)" % (pose, pose_via, pose_to, acc, vel)
        self.send_program(prog)
        if not wait:
            return None
        else:
            self.wait_for_move()
            return self.getl()

    def movels(self, pose_list, acc=0.01, vel=0.01 , radius=0.01, wait=True):
        """
        where pose_list is a list of pose.
        several movel commands must be send as one program in order for radius blending to work.
        """
        #TODO: This is could easily be implemented in movel by detecting type of the joint variable
        # can be implemented by sending a complete urscript program calling several movel in a row with a radius
        header = "def myProg():\n"
        end = "end\n"
        template = "movel(p[{},{},{},{},{},{}], a={}, v={}, r={})\n"
        prog = header
        for idx, pose in enumerate(pose_list):
            pose = [round(i, self.max_float_length) for i in pose]
            pose.append(acc)
            pose.append(vel)
            if idx != (len(pose_list) -1 ):
                pose.append(radius)
            else:
                pose.append(0)
            prog += template.format(*pose)
        prog += end
        print(prog)
        self.send_program(prog)
        if not wait:
            return None
        else:
            self.wait_for_move()
            return self.getl()

    def stopl(self, acc = 100000):
        self.send_program("stopl(%s)" % acc)

    def stopj(self, acc = 1.5):
        self.send_program("stopj(%s)" % acc)

    def stop(self):
        self.stopj()

    def _eq(self, l1, l2):
        """
        robot joints precision is 0.01, donot give anything smaller!!!
        """
        for i in range(0, len(l1)):
            if abs(l1[i] -l2[i]) > self.jointEpsilon:
                return False
        return True

    def _eqpose(self, l1, l2):
        """
        epsilonl is for x,y,z
        epsilonr is for a,b,c
        robot joints precision is 0.01, do not give anything smaller!!!
        """
        for i in range(0, 3):
            if abs(l1[i] - l2[i]) > self.linearEpsilon:
                #print "param: ", i, "val: ", l1[i], "-", l2[i] , "=", abs(l1[i] -l2[i]),  " is not under ", self.linearEpsilon
                return False
        for i in range(3, 6):
            if abs(l1[i] - l2[i]) > self.radialEpsilon:
                #print "param: ", i, "val: ", l1[i], "-", l2[i] , "=", abs(l1[i] -l2[i]),  " is not under ", self.radialEpsilon
                return False
        return True

    def cleanup(self):
        self.logger.info("Closing sockets to robot")
        self.secmon.cleanup()
        if self.rtmon:
            self.rtmon.stop()

    def set_freedrive(self, val):
        if val:
            self.send_program("set robotmode freedrive")
        else:
            self.send_program("set robotmode run")

    def set_simultion(self, val):
        if val:
            self.send_program("set sim")
        else:
            self.send_program("set real")

#nb = raw_input('Choose a number')


if start :
    try:
        rob = URRobot(RobotIP)
        IK = (rob.getj())
        TCP = (rob.getl())
        ProgramStatus = (rob.is_program_running())
        rob.cleanup()

    except:
         print("not working")
# ---------- end scorpion_feedback_connected ----------
code = Code(MultiData=timeline.MultiData)  # -> Code, Warning
panel_2 = Panel(code.Code)
send_ur = Button()
scorpion_uploader_connected = ScorpionUpload(RobotIP="192.168.0.200", SendProgram=send_ur, ProgramInput=panel_2)  # -> out; inputs SendProgram: Boolean, ProgramInput: list
# ---------- scorpion_uploader_connected: Python ----------
import socket, math, time

__author__ = "Khaled ElAshry / vincent Vincent Hygh "
__copyright__ = "Copyright 2013, Khaled ElAshry "
__license__ = "Creative Commons Attribution 4.0 International License"
__version__ = "0.2"



ghenv.Component.Message = 'Scorpion 0.2'

#start ethernet communication
openComm ='socket_open("192.168.0.200",30003)'
scriptS = []
scriptE = []

#for a in range(len(afterEnd)):
#    scriptE.append(afterEnd[a] + "\n")

# setup scipt
msg=""
msg ="def myprog():" + "\n"
msg += "  " + openComm + "\n"
# add setup robot & tool
for a in range(len(scriptS)):
    msg += scriptS[a]
# add toolpath

for a in range(len(ProgramInput)):
    msg += ProgramInput[a]
    a+=1
for a in range(len(scriptE)):
    msg += scriptE[a]
msg += "  stopj(1)"+ "\n"
msg += "end" + "\n"

#print(input)
OUTPUT = msg
print(msg)

if (SendProgram == True):

    PORT = 30003
    sock = socket.socket(socket.AF_INET, socket.SOCK_STREAM)
    sock.settimeout(1)
    print(msg);
    
    #time.sleep(10)
    try:
        sock.connect((RobotIP, PORT))
        sock.send(msg.encode("utf-8"))
        print("sent")

    except:
        print ("socket failed")
        sock.close()
# ---------- end scorpion_uploader_connected ----------
panel_3 = Panel(scorpion_uploader_connected)
